vi "Function.gvi"   [LabVIEW NXG 5.1.0]
panel controls:
  "VISA Resource Name": "VISA Instr" = "COM3"
  "Inicio": bool
  "Stop": bool
panel indicators:
  "Error Out": error
  "String Constant": string
  "Estado": bool
  "Gráfica de Temperatura del Termpo Par": f64
  "Temp": string
types:
  "DataType.gtype" = enum{"Double", "I32", "String", "Boolean", "U64", "Timestamp"}
  "Client Handle.gtype" = u32
  "Configuration.gtype" = cluster{"Server URL": string, "Session": "Client Handle.gtype", "Raw Session Queue": Queue<"Client Handle.gtype">}
  "Tag.gtype" = cluster{"Path": string, "Datatype": "DataType.gtype", "Configuration": "Configuration.gtype"}
uses:
  NI::VISA::Configure Serial Port (Instr).gvi
  NI::Skyline::Configuration::Open Configuration Auto (Desktop).gvi
  NI::Skyline::TagHTTP::Open Tag.gvi
  NI::VISA::Read (Instr, String).gvi
  NI::Skyline::TagHTTP::Write Tag (DBL).gvi
  NI::VISA::Close (Instr).gvi
  NI::Skyline::TagHTTP::Close Tag (Single).gvi
diagram:
  call "Configure Serial Port (Instr).gvi"(session in=$"VISA Resource Name", error in=no error, baud rate=9600) -> (session out=w1, error out=w2)
  call "Open Configuration Auto (Desktop).gvi"() -> (configuration=w3)
  call "Open Tag.gvi"(path="id.temperatura", data type="Double", configuration=w3) -> (tag=w4, error out=w5)
  while {
    $Estado <- $Inicio
    $"Gráfica de Temperatura del Termpo Par" <- 0
    Wait(time to wait=1000)
    case ($Inicio) {
      frame False, Default {
        $"String Constant" <- "Presiona el botón para empezar la lectura"
        w11 = "Tag.gtype" {"Path"="", "Datatype"="Double", "Configuration"={"Server URL"="", "Session"=1, "Raw Session Queue"=refnum}}
        w6 = no error
        w7 = w1
        w8 = $Stop
        w9 = w11
        w10 = no error
      }
      frame True {
        $"String Constant" <- ""
        while {
          Property Node(instance in=w1, error in=w2) -> ("ASRL Bytes at Port"=w12, error out=w13, instance out=w14)
          call "Read (Instr, String).gvi"(session in=w14, error in=w13, byte count=w12) -> (session out=w7, error out=w6, read buffer=w15)
          Concatenate Strings(w15, "°C") -> w16
          $Temp <- w16
          Scan From String(inputString=w15) -> (out0=w17)
          $"Gráfica de Temperatura del Termpo Par" <- w17
          call "Write Tag (DBL).gvi"(tag in=w4, value=w17, error in=w5) -> (tag out=w9, error out=w10)
          w18 = $Stop
          Not(x=w18) -> w19
          $Estado <- w19
          Wait(time to wait=1000)
          stop if w18
        }
        w8 = w18
      }
    }
    Logical Or(w8, $Inicio) -> w20
    stop if w20
  }
  call "Close (Instr).gvi"(session in=w7, error in=w6) -> (error out=w21)
  $"Error Out" <- w21
  call "Close Tag (Single).gvi"(tag=w9, error in=w10)
