vi "Check Out Session.gvi"   [LabVIEW NXG 5.0.0]
inputs:
  "configuration in": "Configuration.gtype", required
  "error in": error
outputs:
  "configuration out": "Configuration.gtype"
  "raw session": "Client Handle.gtype"
  "error out": error
types:
  "Client Handle.gtype" = u32
  "Configuration.gtype" = cluster{"Server URL": string, "Session": "Client Handle.gtype", "Raw Session Queue": Queue<"Client Handle.gtype">}
diagram:
  $"configuration out" <- $"configuration in"
  Property Node(instance in=$"configuration in") -> ("Raw Session Queue"=w1)
  Dequeue Element(queue=w1) -> (element=w2, error out=w3)
  $"raw session" <- w2
  Merge Errors($"error in", w3) -> (error out=w4)
  $"error out" <- w4
