vi "Close Configuration.gvi"   [LabVIEW NXG 5.1.0]
# Terminates connections associated with the configuration and invalidates open references to SystemLink objects on SystemLink Server or SystemLink Cloud.
inputs:
  "configuration": "Configuration.gtype", required
  "error in": error
outputs:
  "error out": error
types:
  "Client Handle.gtype" = u32
  "Configuration.gtype" = cluster{"Server URL": string, "Session": "Client Handle.gtype", "Raw Session Queue": Queue<"Client Handle.gtype">}
uses:
  NI::HTTP::Close HTTP Handle.gvi
diagram:
  Property Node(instance in=$configuration) -> ("Raw Session Queue"=w1, "Session"=w2)
  Dequeue Element(queue=w1) -> (element=w3, error out=w4, queue out=w5)
  Release Queue(error in=w4, force destroy=TRUE, queue=w5) -> (error out=w6)
  call "Close HTTP Handle.gvi"(client handle=w3, error in=w6) -> (error out=w7)
  call "Close HTTP Handle.gvi"(client handle=w2, error in=$"error in") -> (error out=w8)
  Merge Errors(w8, w7) -> (error out=w9)
  $"error out" <- w9
