vi "Close Default Configuration.gvi"   [LabVIEW NXG 5.0.0]
# Terminates connections associated with the configuration and invalidates open references to SystemLink objects on SystemLink Server or SystemLink Cloud.
inputs:
  "configuration": "Default Configuration.gtype", required
  "error in": error
outputs:
  "error out": error
types:
  "Client Handle.gtype" = u32
  "Configuration.gtype" = cluster{"Server URL": string, "Session": "Client Handle.gtype", "Raw Session Queue": Queue<"Client Handle.gtype">}
  "Auto Configuration.gtype" = cluster{"id": string, "uri": string, "api key": string, "cert path": path, "owning file": path}
  "Default Configuration.gtype" = cluster{"configuration": "Configuration.gtype", "generation": i32, "auto configuration": "Auto Configuration.gtype"}
uses:
  NI::Skyline::Configuration::Default Configuration Refcount Store.gvi
  NI::Skyline::Configuration::Close Configuration.gvi
diagram:
  # This VI has an NXG substitution that will need to update if modified.
  # Only close when the refcount store says we're done.
  disable {
    frame 0, Default {
      Property Node(instance in=$configuration) -> ("configuration"=w2, "generation"=w3)
      call "Default Configuration Refcount Store.gvi"(generation=w3, action="Check in existing") -> (close generation?=w4)
      case (w4) {
        frame True {
          call "Close Configuration.gvi"(configuration=w2, error in=$"error in") -> (error out=w1)
        }
        frame False {
          w1 = $"error in"
        }
      }
    }
    frame TARGET_TYPE == "WebServer" {
      # Placeholder for web VI to do nothing
      w1 = $"error in"
    }
  }
  $"error out" <- w1
