vi "Configuration File Cache.gvi"   [LabVIEW NXG 5.0.0]
inputs:
  "configuration id": string
  "expiration time": f64 = 5
  "error in": error
outputs:
  "HTTP configuration": "Auto Configuration.gtype"
  "error out": error
types:
  "Auto Configuration.gtype" = cluster{"id": string, "uri": string, "api key": string, "cert path": path, "owning file": path}
  T1 = cluster{"configuration": "Auto Configuration.gtype", "retrieval time": timestamp}
uses:
  NI::Skyline::Configuration::Read Configuration File.gvi
diagram:
  w1 = T1 {all zero or empty}  # cache entry
  # variant keys can't be empty
  Is Empty String Or Path(string/path=$"configuration id") -> w2
  Select(s=w2, t="*", f=$"configuration id") -> w3
  w4 = variant()  # cache
  Feedback Node(initial value=w4, input=w5) -> w6
  Get Variant Attribute(default value=w1, error in=$"error in", name=w3, variant=w6) -> (error out=w7, found?=w8, value=w9, variant out=w10)
  case (w8) {
    frame False, Default {
      # Not cached
      w11 = w10
      w12 = w7
      w13 = default
      w14 = default
      w15 = w3
    }
    frame True {
      Property Node(instance in=w9) -> ("retrieval time"=w16, "configuration:owning file"=w17, "configuration"=w18)
      # Validate the cache entry
      Get Current Time() -> (current time=w19)
      Timestamp Subtract(x=w19, y=w16) -> w20
      Is Greater(x=w20, y=$"expiration time") -> w21
      case (w21) {
        frame False, Default {
          w12 = w7
          w11 = w10
          w13 = w8
          w14 = w18
          w15 = w3
        }
        frame True {
          File Or Directory Info(error in=w7, path=w17) -> (last mod=w22)
          Is Greater(x=w22, y=w16) -> w23
          # Expired entry: check if the file has been modified.
          case (w23) {
            frame False, Default {
              # File not modified: refresh the time
              Property Node(instance in=w9, "retrieval time"=w19) -> (instance out=w24)
              Set Variant Attribute(error in=w7, name=w3, value=w24, variant=w10) -> (error out=w12, variant out=w11)
              w13 = TRUE
              w14 = w18
              w15 = w3
            }
            frame True {
              # Evict
              Delete Variant Attribute(error in=w7, name=w3, variant in=w10) -> (error out=w12, variant out=w11)
              w13 = default
              w14 = default
              w15 = w3
            }
          }
        }
      }
    }
  }
  case (w13) {
    frame False, Default {
      call "Read Configuration File.gvi"(configuration id=$"configuration id", error in=w12) -> (HTTP configuration=w26, error out=w27)
      Get Current Time() -> (current time=w28)
      Property Node(instance in=w1, "configuration"=w26, "retrieval time"=w28) -> (instance out=w29)
      Set Variant Attribute(error in=w27, name=w15, value=w29, variant=w11) -> (error out=w25, variant out=w5)
    }
    frame True {
      w25 = w12
      w26 = w14
      w5 = w11
    }
  }
  $"HTTP configuration" <- w26
  $"error out" <- w25
