vi "Default Configuration Refcount Store.gvi"   [LabVIEW NXG 5.0.0]
inputs:
  "generation": i32 = -1, required
  "action": "Default Refcount Store Action.gtype" = "Create new generation", required
outputs:
  "generation created": i32
  "close generation?": bool
types:
  "Default Refcount Store Action.gtype" = enum{"Create new generation", "Check out generation", "Check in existing"}
diagram:
  w1 = cluster{"generation": i32, "refcounts": i32[]} {"generation"=-1, "refcounts"=[]}
  Feedback Node(initial value=w1, input=w2) -> w3
  case ($action) {
    frame "Create new generation" {
      in-place {
        Unbundle Bundle Read Poser() -> ("refcounts"=w6)
        Search 1D Array(1D array=w6, element=0) -> (index of element=w7)
        case (w7) {
          frame ..-1 {
            Insert Into Array(inArray=w6, new=1) -> w8
            Array Size(array=w6) -> (size(s)=w4)
          }
          frame 0.. {
            Replace Array Subset(inArray=w6, index=w7, new=1) -> w8
            w4 = w7
          }
        }
        Unbundle Bundle Write Poser("refcounts"=w8, "generation"=w4)
        Array Index(array=w6) -> (out0[$generation]=w9)
        Is Equal To 0(x=w9) -> w10
        Is Greater Or Equal To 0(x=$generation) -> w11
        Logical And(w10, w11) -> w5
      }
    }
    frame "Check out generation" {
      in-place {
        Unbundle Bundle Read Poser() -> ("refcounts"=w12)
        in-place {
          Array Index Replace Read Poser(array=w12) -> (out0[$generation]=w13)
          Increment(x=w13) -> w14
          Array Index Replace Write Poser(in=w14) -> (array=w15, out0=w16)
        }
        Unbundle Bundle Write Poser("refcounts"=w15, "generation"=w16)
      }
      w4 = default
      w5 = default
    }
    frame "Check in existing" {
      in-place {
        Unbundle Bundle Read Poser() -> ("generation"=w17, "refcounts"=w18)
        in-place {
          Array Index Replace Read Poser(array=w18) -> (out0[$generation]=w19)
          Decrement(x=w19) -> w20
          Is Less Or Equal To 0(x=w20) -> w21
          Array Index Replace Write Poser(in=w20) -> (array=w22, out0=w23)
        }
        Is Not Equal(x=w17, y=w23) -> w24
        Logical And(w24, w21) -> w5
        Unbundle Bundle Write Poser("generation"=w17, "refcounts"=w22)
      }
      w4 = default
    }
  }
  $"close generation?" <- w5
  $"generation created" <- w4
