vi "Find HTTP Configuration By Id.gvi"   [LabVIEW NXG 5.0.0]
inputs:
  "HTTP configurations": "Auto Configuration.gtype"[], required
  "configuration id": string, required
  "error in": error
outputs:
  "HTTP configuration": "Auto Configuration.gtype"
  "found?": bool
  "error out": error
types:
  "Auto Configuration.gtype" = cluster{"id": string, "uri": string, "api key": string, "cert path": path, "owning file": path}
uses:
  NI::G Core::Error::Legacy::Error Cluster From Error Code.gvi
diagram:
  case ($"error in") {
    frame No Error {
      s1 = FALSE  # shift register
      s2 = $"error in"  # shift register
      for {
        w4 = each element of $"HTTP configurations"
        Property Node(instance in=w4) -> ("id"=w5)
        To Upper Case(string=w5) -> w6
        Is Equal(x=$"configuration id", y=w6) -> w7
        case (w7) {
          frame False, Default {
            w8 = s1
            w9 = s2
            w10 = default
            w11 = default
          }
          frame True {
            case (s1) {
              frame False, Default {
                w9 = s2
              }
              frame True {
                w12 = "-251013: Unable to open configuration. More than one HTTP configuration with ID '%s' exists."
                Format Into String(formatString=w12, $"configuration id") -> w13
                call "Error Cluster From Error Code.gvi"(error code=-251013, error message=w13, show call chain?=TRUE, is warning?=FALSE) -> (error out=w9)
              }
            }
            w8 = TRUE
            w10 = w4
            w11 = TRUE
          }
        }
        w3 = w10 if w11
        next s1 = w8
        next s2 = w9
        stop if w9
      }
      w1 = s1
      w2 = s2
    }
    frame Error {
      w1 = default
      w2 = $"error in"
      w3 = default
    }
  }
  $"found?" <- w1
  $"error out" <- w2
  $"HTTP configuration" <- w3
