vi "Get Skyline Data Directory.gvi"   [LabVIEW NXG 5.0.0]
inputs:
  "error in": error
outputs:
  "path": path
  "error out": error
uses:
  NI::G Core::File IO (General)::Get System Directory.gvi
  NI::G Core::Error::Legacy::Error Cluster From Error Code.gvi
diagram:
  # This VI has an NXG substitution that will need to update if modified.
  disable {
    frame TARGET_TYPE=="Windows" {
      call "Get System Directory.gvi"(type="Public Application Data") -> (system directory=w3)
      Build Path(base path=w3, name or relative path=path "National Instruments\\Skyline") -> (appended path=w1)
      w2 = $"error in"
    }
    frame TARGET_TYPE=="RT" {
      w1 = path "etc\\natinst\\niskyline"
      w2 = $"error in"
    }
    frame 2, Default {
      w4 = "-251011: Unable to open configuration. Unsupported platform."
      call "Error Cluster From Error Code.gvi"(error code=-251011, error message=w4, show call chain?=TRUE, is warning?=FALSE) -> (error out=w5)
      Merge Errors($"error in", w5) -> (error out=w2)
      w1 = default
    }
  }
  $path <- w1
  $"error out" <- w2
