vi "Initialize From Auto Configuration.gvi"   [LabVIEW NXG 5.0.0]
inputs:
  "auto configuration": "Auto Configuration.gtype", required
  "error in": error
  "verify server?": bool = TRUE
  "require secure?": bool = TRUE
    # When using HTTPS, verify server specifies whether Skyline data APIs should reject connections that they cannot securely verify. By default, all HTTPS connections are verified to ensure secure communication with the intended server. Wiring false to this input will disable server verification, which makes connections insecure, but enables connecting to servers that use self-signed certificates without needing to obtain a copy of the certificate ahead of time.
    # When possible, install a trusted certificate on the web server, or use ca certificate file to specify the location of the server's root certificate instead of disabling server verification.
    # The verify server input has no effect when using HTTP connections, which are always insecure.
outputs:
  "configuration": "Configuration.gtype"
  "error out": error
types:
  "Client Handle.gtype" = u32
  "Configuration.gtype" = cluster{"Server URL": string, "Session": "Client Handle.gtype", "Raw Session Queue": Queue<"Client Handle.gtype">}
  "Auto Configuration.gtype" = cluster{"id": string, "uri": string, "api key": string, "cert path": path, "owning file": path}
uses:
  NI::G Core::File IO (General)::Is Path and Not Empty.gvi
  NI::Skyline::Configuration::Get Skyline Data Directory.gvi
  NI::G Core::Error::Legacy::Error Cluster From Error Code.gvi
  NI::Skyline::Configuration::Open Configuration API Key (Desktop).gvi
diagram:
  Property Node(instance in=$"auto configuration") -> ("uri"=w1, "api key"=w2, "cert path"=w3)
  call "Is Path and Not Empty.gvi"(path=w3) -> (path and not empty?=w4)
  case (w4) {
    frame False, Default {
      w5 = default
      w6 = default
    }
    frame True {
      call "Get Skyline Data Directory.gvi"() -> (path=w7, error out=w6)
      Build Path(base path=w7, name or relative path="Certificates") -> (appended path=w8)
      Build Path(base path=w8, name or relative path=w3) -> (appended path=w5)
    }
  }
  case ($"require secure?") {
    frame False, Default {
      w9 = TRUE
    }
    frame True {
      Match Pattern(regular expression="^https://", string=w1) -> (offset past match=w10)
      Is Greater Or Equal To 0(x=w10) -> w9
    }
  }
  case (w9) {
    frame False, Default {
      Match Pattern(regular expression="://", string=w1) -> (after substring=w12, before substring=w13, offset past match=w14)
      Is Less Than 0(x=w14) -> w15
      Select(s=w15, t=w13, f=w12) -> w16
      Match Pattern(regular expression="[:/]", string=w16) -> (before substring=w17)
      # NOTE: We don't attempt to detect [::1]
      Select(s=w15, t="http", f=w13) -> w18
      case (w17) ignore case {
        frame Default {
          w19 = "-251251: Unable to open configuration. 'secure only' was specified but the server is configured for non-local access over '%s'."
          Format Into String(formatString=w19, w18) -> w20
          call "Error Cluster From Error Code.gvi"(error code=-251251, error message=w20, show call chain?=TRUE, is warning?=FALSE) -> (error out=w11)
        }
        frame "127.0.0.1", "localhost" {
          w11 = default
        }
      }
    }
    frame True {
      w11 = default
    }
  }
  Merge Errors($"error in", w11, w6) -> (error out=w21)
  call "Open Configuration API Key (Desktop).gvi"(ca certificate file=w5, server url=w1, api key=w2, error in=w21, verify server?=$"verify server?") -> (configuration=w22, error out=w23)
  $configuration <- w22
  $"error out" <- w23
