vi "Open Configuration (Desktop).gvi"   [LabVIEW NXG 5.0.0]
# Initializes an HTTP connection for SystemLink data services to communicate with your SystemLink Server using your SystemLink Server login credentials.
# Wire the server to connect to in the server url input with the format scheme://host:port. Clean up connections associated with the configuration by wiring the configuration to Close Configuration.
inputs:
  "ca certificate file": path
    # When using HTTPS, ca certificate file specifies the path to a list of root certificates that Skyline data APIs trust when verify server is TRUE. By default, web server certificates are verified against a pre-installed list of CA certificates. When connecting to servers that use self-signed certificates or certificates signed by a non-standard CA, first obtain a copy of the server's root certificate and then wire the path to that certificate to ca certificate file.
    # The certificate file may contain multiple certificates, one after the other, to enable connecting to mulitple servers that use different certificates.
    # This input has no effect when using HTTP connections, which are always insecure.
  "server url": string, required
  "username": string
  "password": string
  "error in": error
  "verify server?": bool = TRUE
    # When using HTTPS, verify server specifies whether Skyline data APIs should reject connections that they cannot securely verify. By default, all HTTPS connections are verified to ensure secure communication with the intended server. Wiring false to this input will disable server verification, which makes connections insecure, but enables connecting to servers that use self-signed certificates without needing to obtain a copy of the certificate ahead of time.
    # When possible, install a trusted certificate on the web server, or use ca certificate file to specify the location of the server's root certificate instead of disabling server verification.
    # The verify server input has no effect when using HTTP connections, which are always insecure.
outputs:
  "configuration": "Configuration.gtype"
  "error out": error
types:
  "Client Handle.gtype" = u32
  "Configuration.gtype" = cluster{"Server URL": string, "Session": "Client Handle.gtype", "Raw Session Queue": Queue<"Client Handle.gtype">}
uses:
  NI::G Core::File IO (General)::Is Path and Not Empty.gvi
  NI::Skyline::Configuration::Open Session with Credentials.gvi
  NI::HTTP::Configure SSL.gvi
  NI::HTTP::Add Header.gvi
diagram:
  Match Pattern(regular expression="/*$", string=$"server url") -> (before substring=w1)
  Is Empty String Or Path(string/path=$"server url") -> w2
  Not(x=w2) -> w3
  Match Pattern(regular expression="://", string=$"server url") -> (offset past match=w4)
  Is Less Than 0(x=w4) -> w5
  Logical And(w3, w5) -> w6
  case (w6) {
    frame False, Default {
      # Protocol specified or using empty string to represent host server.
      w7 = w1
    }
    frame True {
      # No protocol specified, default to http so it doesn't get treated as a relative URL.
      Concatenate Strings("http://", w1) -> w7
    }
  }
  call "Is Path and Not Empty.gvi"(path=$"ca certificate file") -> (path and not empty?=w8)
  call "Open Session with Credentials.gvi"(verify server?=$"verify server?", username=$username, password=$password, error in=$"error in") -> (session 1=w9, session 2=w10, error out=w11)
  # Remove all trailing '/'
  case (w8) {
    frame False, Default {
      w12 = w11
      w13 = w9
      w14 = w10
    }
    frame True {
      call "Configure SSL.gvi"(verify server=$"verify server?", client handle=w10, CA certificate file=$"ca certificate file", error in=w11) -> (client handle out=w14, error out=w15)
      call "Configure SSL.gvi"(verify server=$"verify server?", client handle=w9, CA certificate file=$"ca certificate file", error in=w15) -> (client handle out=w13, error out=w12)
    }
  }
  call "Add Header.gvi"(client handle=w13, header="Content-Type", value="application/json", error in=w12) -> (client handle out=w16, error out=w17)
  Obtain Queue(element data type=w14, error in=w17, max queue size=1) -> (error out=w18, queue out=w19)
  Enqueue Element(element=w14, error in=w18, queue=w19) -> (error out=w20, queue out=w21)
  Property Node(instance in="Configuration.gtype" {all zero or empty}, "Server URL"=w7, "Session"=w16, "Raw Session Queue"=w21) -> (instance out=w22)
  $configuration <- w22
  $"error out" <- w20
