vi "Open Configuration API Key (Desktop).gvi"   [LabVIEW NXG 5.0.0]
# Initializes an HTTP connection for SystemLink data services to communicate with SystemLink Cloud using an API key for authentication. The VI authenticates the connection with an API key obtained from SystemLink Cloud.
# Wire the server to connect to in the server url with the format scheme://host:port. To communicate with SystemLink Cloud, use https://api.systemlinkcloud.com. Clean up connections associated with the configuration by wiring the configuration to Close Configuration.
inputs:
  "ca certificate file": path
    # When using HTTPS, ca certificate file specifies the path to a list of root certificates that Skyline data APIs trust when verify server is TRUE. By default, web server certificates are verified against a pre-installed list of CA certificates. When connecting to servers that use self-signed certificates or certificates signed by a non-standard CA, first obtain a copy of the server's root certificate and then wire the path to that certificate to ca certificate file.
    # The certificate file may contain multiple certificates, one after the other, to enable connecting to mulitple servers that use different certificates.
    # This input has no effect when using HTTP connections, which are always insecure.
  "server url": string, required
  "api key": string, required
  "error in": error
  "verify server?": bool = TRUE
    # When using HTTPS, verify server specifies whether Skyline data APIs should reject connections that they cannot securely verify. By default, all HTTPS connections are verified to ensure secure communication with the intended server. Wiring false to this input will disable server verification, which makes connections insecure, but enables connecting to servers that use self-signed certificates without needing to obtain a copy of the certificate ahead of time.
    # When possible, install a trusted certificate on the web server, or use ca certificate file to specify the location of the server's root certificate instead of disabling server verification.
    # The verify server input has no effect when using HTTP connections, which are always insecure.
outputs:
  "configuration": "Configuration.gtype"
  "error out": error
types:
  "Client Handle.gtype" = u32
  "Configuration.gtype" = cluster{"Server URL": string, "Session": "Client Handle.gtype", "Raw Session Queue": Queue<"Client Handle.gtype">}
uses:
  NI::Skyline::Configuration::Open Configuration (Desktop).gvi
  NI::HTTP::Add Header.gvi
diagram:
  call "Open Configuration (Desktop).gvi"(ca certificate file=$"ca certificate file", server url=$"server url", error in=$"error in", verify server?=$"verify server?") -> (configuration=w1, error out=w2)
  $configuration <- w1
  Property Node(instance in=w1) -> ("Session"=w3, "Raw Session Queue"=w4)
  Preview Queue Element(error in=w2, queue=w4, timeout in ms=0) -> (element=w5, error out=w6)
  Is Empty String Or Path(string/path=$"api key") -> w7
  case (w7) {
    frame False, Default {
      call "Add Header.gvi"(client handle=w5, header="X-NI-API-Key", value=$"api key", error in=w6) -> (error out=w9)
      call "Add Header.gvi"(client handle=w3, header="X-NI-API-Key", value=$"api key", error in=w9) -> (error out=w8)
    }
    frame True {
      w8 = w6
    }
  }
  $"error out" <- w8
