vi "Open Configuration Auto (Custom).gvi"   [LabVIEW NXG 5.0.0]
# Initializes an HTTP connection for SystemLink data services to communicate with your SystemLink Server by automatically retrieving credentials when executed on a managed system or a SystemLink Server.
# Connection information, stored in SystemLink HTTP configuration files, must already be installed on the system. Wire the name of the configuration to use to configuration id, or leave it unwired to use the default, which will connect to the server managing the system is configured, or to a locally installed server if not. Clean up connections associated with the configuration by wiring the configuration to Close Configuration.
inputs:
  "configuration id": string
  "error in": error
  "verify server?": bool = TRUE
    # When using HTTPS, verify server specifies whether Skyline data APIs should reject connections that they cannot securely verify. By default, all HTTPS connections are verified to ensure secure communication with the intended server. Wiring false to this input will disable server verification, which makes connections insecure, but enables connecting to servers that use self-signed certificates without needing to obtain a copy of the certificate ahead of time.
    # When possible, install a trusted certificate on the web server, or use ca certificate file to specify the location of the server's root certificate instead of disabling server verification.
    # The verify server input has no effect when using HTTP connections, which are always insecure.
  "HTTPS only?": bool = TRUE
    # When using HTTPS, verify server specifies whether Skyline data APIs should reject connections that they cannot securely verify. By default, all HTTPS connections are verified to ensure secure communication with the intended server. Wiring false to this input will disable server verification, which makes connections insecure, but enables connecting to servers that use self-signed certificates without needing to obtain a copy of the certificate ahead of time.
    # When possible, install a trusted certificate on the web server, or use ca certificate file to specify the location of the server's root certificate instead of disabling server verification.
    # The verify server input has no effect when using HTTP connections, which are always insecure.
outputs:
  "configuration": "Configuration.gtype"
  "error out": error
types:
  "Client Handle.gtype" = u32
  "Configuration.gtype" = cluster{"Server URL": string, "Session": "Client Handle.gtype", "Raw Session Queue": Queue<"Client Handle.gtype">}
uses:
  NI::Skyline::Configuration::Configuration File Cache.gvi
  NI::Skyline::Configuration::Initialize From Auto Configuration.gvi
  NI::Skyline::Configuration::Open Configuration (Desktop).gvi
diagram:
  # This VI has an NXG substitution that will need to update if modified.
  # Placeholder for web VI condition
  disable {
    frame 0, Default {
      call "Configuration File Cache.gvi"(configuration id=$"configuration id", expiration time=0, error in=$"error in") -> (HTTP configuration=w3, error out=w4)
      call "Initialize From Auto Configuration.gvi"(auto configuration=w3, error in=w4, verify server?=$"verify server?", require secure?=$"HTTPS only?") -> (configuration=w2, error out=w1)
    }
    frame TARGET_TYPE == "WebServer" {
      call "Open Configuration (Desktop).gvi"(server url="", error in=$"error in", verify server?=$"verify server?") -> (configuration=w2, error out=w1)
    }
  }
  $configuration <- w2
  $"error out" <- w1
