vi "Open Default Configuration.gvi"   [LabVIEW NXG 5.0.0]
# Retrieves an HTTP connection for SystemLink data services to communicate with your SystemLink Server by automatically retrieving credentials when executed on a managed system or a SystemLink Server.
# Clean up connections associated with the configuration by wiring the configuration to Close Configuration.
inputs:
  "cache expiration time": f64 = 5
  "error in": error
outputs:
  "configuration": "Default Configuration.gtype"
  "error out": error
types:
  "Client Handle.gtype" = u32
  "Configuration.gtype" = cluster{"Server URL": string, "Session": "Client Handle.gtype", "Raw Session Queue": Queue<"Client Handle.gtype">}
  "Auto Configuration.gtype" = cluster{"id": string, "uri": string, "api key": string, "cert path": path, "owning file": path}
  "Default Configuration.gtype" = cluster{"configuration": "Configuration.gtype", "generation": i32, "auto configuration": "Auto Configuration.gtype"}
uses:
  NI::Skyline::Configuration::Configuration File Cache.gvi
  NI::Skyline::Configuration::Default Configuration Refcount Store.gvi
  NI::Skyline::Configuration::Initialize From Auto Configuration.gvi
  NI::Skyline::Configuration::Close Configuration.gvi
  NI::Skyline::Configuration::Open Configuration.gvi
diagram:
  # This VI has an NXG substitution that will need to update if modified.
  disable {
    frame 0, Default {
      call "Configuration File Cache.gvi"(expiration time=$"cache expiration time", error in=$"error in") -> (HTTP configuration=w3, error out=w4)
      case (w4) {
        frame No Error {
          # cached instance
          Feedback Node(initial value="Default Configuration.gtype" {all zero or empty}, input=w2) -> w5
          Property Node(instance in=w5) -> ("configuration:Raw Session Queue"=w6, "auto configuration"=w7)
          Is Not A Number Or Path Or Refnum(number=w6) -> w8
          Is Not Equal[ComparisonMode=CompareAggregates](x=w7, y=w3) -> w9
          Logical Or(w8, w9) -> w10
          # Validate our cached instance:
          # 1. The refnum may get auto-closed
          # 2. The configuration could change
          case (w10) {
            frame False, Default {
              Property Node(instance in=w5) -> ("generation"=w11)
              # Bump the ref count before returning the cached instance.
              call "Default Configuration Refcount Store.gvi"(generation=w11, action="Check out generation")
              w1 = w4
              w2 = w5
            }
            frame True {
              call "Initialize From Auto Configuration.gvi"(auto configuration=w3, error in=w4, require secure?=FALSE) -> (configuration=w12, error out=w13)
              # Replace our cached instance with a new one.
              case (w13) {
                frame No Error {
                  Property Node(instance in=w5) -> ("generation"=w14, "configuration"=w15)
                  call "Default Configuration Refcount Store.gvi"(generation=w14, action="Create new generation") -> (generation created=w16, close generation?=w17)
                  case (w17) {
                    frame False, Default { }
                    frame True {
                      call "Close Configuration.gvi"(configuration=w15)
                    }
                  }
                  Property Node(instance in="Default Configuration.gtype" {all zero or empty}, "generation"=w16, "configuration"=w12, "auto configuration"=w3) -> (instance out=w2)
                  w1 = w13
                }
                frame Error {
                  w1 = w13
                  w2 = w5
                }
              }
            }
          }
        }
        frame Error {
          w2 = default
          w1 = w4
        }
      }
    }
    frame TARGET_TYPE == "WebServer" {
      # Placeholder for NXG web VI implementation
      s1 = uninitialised  # shift register
      s2 = uninitialised  # shift register
      while {
        # Web VI doesn't support feedback nodes or first call
        case (s2) {
          frame False, Default {
            call "Open Configuration.gvi"(error in=$"error in") -> (configuration=w19, error out=w1)
            Property Node(instance in="Default Configuration.gtype" {all zero or empty}, "configuration"=w19) -> (instance out=w20)
            Select(s=w1, t=s1, f=w20) -> w18
          }
          frame True {
            w1 = $"error in"
            w18 = s1
          }
        }
        next s1 = w18
        next s2 = TRUE
        stop if TRUE
      }
      w2 = s1
    }
  }
  $configuration <- w2
  $"error out" <- w1
