vi "Open Session with Credentials.gvi"   [LabVIEW NXG 5.0.0]
inputs:
  "verify server?": bool
  "username": string
  "password": string
  "error in": error
outputs:
  "session 1": "Client Handle.gtype"
  "session 2": "Client Handle.gtype"
  "error out": error
types:
  "Client Handle.gtype" = u32
uses:
  NI::Skyline::Configuration::base64.gvi
  NI::HTTP::Open HTTP Handle.gvi
  NI::HTTP::Add Header.gvi
  NI::HTTP::Configure CORS.gvi
  NI::Skyline::Configuration::Report HTTP Library Not Found Error.gvi
diagram:
  Is Empty String Or Path(string/path=$username) -> w1
  case (w1) {
    frame True {
      w2 = default
    }
    frame False {
      Concatenate Strings($username, ":", $password) -> w3
      call "base64.gvi"(string=w3) -> (encoded string=w4)
      Concatenate Strings("Basic ", w4) -> w2
    }
  }
  # This VI has an NXG substitution that will need to update if modified.
  # Open two sessions, but only compute the basic auth header once.
  s1 = $"error in"  # shift register
  for (N = 2) {
    Is Empty String Or Path(string/path=w2) -> w6
    call "Open HTTP Handle.gvi"(verify server=$"verify server?", error in=s1) -> (client handle out=w7, error out=w8)
    case (w6) {
      frame True {
        w9 = w8
        w10 = w7
      }
      frame False {
        # Request that the web server use basic authentication.
        call "Add Header.gvi"(client handle=w7, header="X-NI-Auth-Method", value="Basic", error in=w8) -> (client handle out=w11, error out=w12)
        call "Add Header.gvi"(client handle=w11, header="Authorization", value=w2, error in=w12) -> (client handle out=w10, error out=w9)
      }
    }
    # Placeholder for configure CORS in NXG web VI.
    disable {
      frame TARGET_TYPE == "WebServer" {
        call "Configure CORS.gvi"(client handle=w10, include credentials during CORS=TRUE, error in=w9) -> (client handle out=w14, error out=w13)
      }
      frame 1, Default {
        w13 = w9
        w14 = w10
      }
    }
    append w14 to w5
    next s1 = w13
  }
  Array Index(array=w5) -> (out0[_]=w15, out1[_]=w16)
  $"session 1" <- w15
  $"session 2" <- w16
  call "Report HTTP Library Not Found Error.gvi"(error in=s1) -> (error out=w17)
  $"error out" <- w17
