vi "Read Configuration File.gvi"   [LabVIEW NXG 5.0.0]
inputs:
  "configuration id": string
  "error in": error
outputs:
  "HTTP configuration": "Auto Configuration.gtype"
  "error out": error
types:
  "Auto Configuration.gtype" = cluster{"id": string, "uri": string, "api key": string, "cert path": path, "owning file": path}
  T1 = cluster{"Id": string, "DisplayName": string, "ConnectionType": string, "Uri": string, "ApiKey": string, "CertPath": string}
uses:
  NI::Skyline::Configuration::Get Skyline Data Directory.gvi
  NI::Skyline::Configuration::Find HTTP Configuration By Id.gvi
  NI::Skyline::Configuration::Validate Auto Configuration.gvi
  NI::G Core::Error::Legacy::Error Cluster From Error Code.gvi
diagram:
  call "Get Skyline Data Directory.gvi"(error in=$"error in") -> (path=w1, error out=w2)
  Build Path(base path=w1, name or relative path="HttpConfigurations") -> (appended path=w3)
  List Folder(error in=w2, path=w3, pattern="*.json") -> (error out=w4, file names=w5, path out=w6)
  Is Empty Array(array=w5) -> w7
  case (w7) {
    frame False, Default {
      for {
        w10 = each element of w5
        w12 = T1 {all zero or empty}  # HTTP configuration
        Build Path(base path=w6, name or relative path=w10) -> (appended path=w13)
        Read From Text File(file (use dialog)=w13) -> (error out=w14, text=w15)
        Unflatten From Json(JSON string=w15, default null elements=TRUE, error in (no error)=w14, type and defaults=w12) -> (error out=w16, value=w17)
        Not(x=w16) -> w18
        Property Node(instance in=w17) -> ("Id"=w19, "Uri"=w20, "ApiKey"=w21, "CertPath"=w22)
        String To Path(string=w22) -> (path=w23)
        Property Node(instance in="Auto Configuration.gtype" {all zero or empty}, "id"=w19, "uri"=w20, "api key"=w21, "cert path"=w23, "owning file"=w13) -> (instance out=w24)
        append w24 to w11 if w18
      }
      Is Empty String Or Path(string/path=$"configuration id") -> w25
      case (w25) {
        frame False, Default {
          To Upper Case(string=$"configuration id") -> w26
          w27 = default
        }
        frame True {
          w28 = TRUE  # enable fallback
          w26 = "SYSTEMLINK_MASTER"
          w27 = w28
        }
      }
      call "Find HTTP Configuration By Id.gvi"(HTTP configurations=w11, configuration id=w26, error in=w4) -> (HTTP configuration=w29, found?=w30, error out=w31)
      Implies(x=w27, y=w30) -> w32
      case (w32) {
        frame False, Default {
          call "Find HTTP Configuration By Id.gvi"(HTTP configurations=w11, configuration id="SYSTEMLINK_LOCALHOST", error in=w31) -> (HTTP configuration=w8, found?=w34, error out=w33)
        }
        frame True {
          w8 = w29
          w33 = w31
          w34 = w30
        }
      }
      call "Validate Auto Configuration.gvi"(auto configuration=w8, found?=w34, error in=w33, requested configuration id=$"configuration id") -> (error out=w9)
    }
    frame True {
      w35 = "-251011: Unable to open configuration. No SystemLink HTTP Configuration files are available. Automatic configuration is only available when running on a managed system or on the server itself."
      call "Error Cluster From Error Code.gvi"(error code=-251011, error message=w35, show call chain?=TRUE, is warning?=FALSE) -> (error out=w36)
      Merge Errors(w4, w36) -> (error out=w9)
      w8 = default
    }
  }
  $"HTTP configuration" <- w8
  $"error out" <- w9
