vi "Report HTTP Library Not Found Error.gvi"   [LabVIEW NXG 5.0.0]
inputs:
  "error in": error
outputs:
  "error out": error
uses:
  NI::G Core::Error::Legacy::Clear Errors.gvi
  NI::G Core::Error::Legacy::Error Cluster From Error Code.gvi
diagram:
  call "Clear Errors.gvi"(specific error code to clear=7, error in=$"error in") -> (specific error cleared?=w1, error out=w2)
  case (w1) {
    frame False, Default {
      w3 = w2
    }
    frame True {
      w4 = "-251046: Unable to load the LabVIEW HTTP client library. Ensure the HTTP Client is installed on the target system."
      call "Error Cluster From Error Code.gvi"(error code=-251046, error message=w4, show call chain?=TRUE, is warning?=FALSE) -> (error out=w3)
    }
  }
  $"error out" <- w3
