vi "Validate Auto Configuration.gvi"   [LabVIEW NXG 5.0.0]
inputs:
  "auto configuration": "Auto Configuration.gtype", required
  "found?": bool, required
  "error in": error
  "requested configuration id": string, required
outputs:
  "error out": error
types:
  "Auto Configuration.gtype" = cluster{"id": string, "uri": string, "api key": string, "cert path": path, "owning file": path}
uses:
  NI::G Core::Error::Legacy::Error Cluster From Error Code.gvi
diagram:
  case ($"found?") {
    frame False, Default {
      w2 = "-251013: Unable to open configuration. No HTTP configuration with ID '%s' exists."
      Format Into String(formatString=w2, $"requested configuration id") -> w3
      call "Error Cluster From Error Code.gvi"(error code=-251013, error message=w3, show call chain?=TRUE, is warning?=FALSE) -> (error out=w1)
    }
    frame True {
      Property Node(instance in=$"auto configuration") -> ("uri"=w4, "id"=w5)
      Is Empty String Or Path(string/path=w4) -> w6
      case (w6) {
        frame False, Default {
          w1 = default
        }
        frame True {
          w7 = "-251013: Unable to open configuration. The HTTP Configuration file '%s' does not specify a URL."
          Format Into String(formatString=w7, w5) -> w8
          call "Error Cluster From Error Code.gvi"(error code=-251013, error message=w8, show call chain?=TRUE, is warning?=FALSE) -> (error out=w1)
        }
      }
    }
  }
  Merge Errors($"error in", w1) -> (error out=w9)
  $"error out" <- w9
