vi "base64.gvi"   [LabVIEW NXG 5.0.0]
inputs:
  "string": string, required
outputs:
  "encoded string": string
diagram:
  w1 = "UTF-8"  # String Encoding
  String To Byte Array(encoding=w1, string=$string) -> (unsigned byte array=w2)
  Array Size(array=w2) -> (size(s)=w3)
  Quotient And Remainder(x=w3, y=3) -> (floor(x/y)=w4, x-y*floor(x/y)=w5)
  case (w5) {
    frame 0, Default {
      w6 = w4
      w7 = ""
    }
    frame 1 {
      Increment(x=w4) -> w6
      w7 = "=="
    }
    frame 2 {
      Increment(x=w4) -> w6
      w7 = "="
    }
  }
  w8 = ["A", "B", "C", "D", "E", "F", "G", "H", "I", "J", "K", "L", "M", "N", "O", "P", "Q", "R", "S", "T", "U", "V", "W", "X", "Y", "Z", "a", "b", "c", "d", "e", "f", "g", "h", "i", "j", "k", "l", "m", "n", "o", "p", "q", "r", "s", "t", "u", "v", "w", "x", "y", "z", "0", "1", "2", "3", "4", "5", "6", "7", "8", "9", "+", "/"]
  s1 = ""  # shift register
  s2 = w2  # shift register
  for (N = w6) {
    Split 1D Array(array=s2, index=3) -> (first subarray=w9, second subarray=w10)
    # right shift 4
    # left shift 2
    Array Index(array=w9) -> (out0[_]=w11, out1[_]=w12, out2[_]=w13)
    # right shift 2
    # left shift 4
    # Base64 encoding takes three characters at a time (24-bits), splits them into 4 6-bit words, then passes each word through a lookup table. The result is then padded on the right with = characters to become a multiple of 24-bits. The loop's final iteration will produce 0's on the right (which become A's), which we replace with the padding at the end.
    #
    # To work around web VI limitations, we multiple and divide instead of use bit shifts.
    Quotient And Remainder(x=w11, y=4) -> (floor(x/y)=w14)
    Multiply(16, w11) -> w15
    Quotient And Remainder(x=w12, y=16) -> (floor(x/y)=w16)
    Logical Or(w15, w16) -> w17
    Logical And(w17, 63) -> w18
    Multiply(4, w12) -> w19
    # right shift 6
    Quotient And Remainder(x=w13, y=64) -> (floor(x/y)=w20)
    Logical Or(w19, w20) -> w21
    Logical And(63, w21) -> w22
    # bit masking
    Logical And(63, w13) -> w23
    Array Index(array=w8) -> (out0[w14]=w24, out1[w18]=w25, out2[w22]=w26, out3[w23]=w27)
    Concatenate Strings(s1, w24, w25, w26, w27) -> w28
    next s1 = w28
    next s2 = w10
  }
  String Length(string=w7) -> (length=w29)
  String Length(string=s1) -> (length=w30)
  Subtract(x=w30, y=w29) -> w31
  Replace Substring(length (len. of substring)=w29, offset=w31, string=s1, substring=w7) -> (result string=w32)
  $"encoded string" <- w32
